# Dynamo graph Tray_Divider_Placement.dyn (Dynamo 2.6.2.15705)
# packages: Universo_BIM 19.10.11, Genius Loci 2022.1.5, bimorphNodes 4.0.13, Spring - Dynamo 2.0 0.0.3

select_model_elements = DSModelElementsSelection()  # 31 picked in the model
getLocation = Element.GetLocation(element=select_model_elements)
length = Curve.Length(curve=getLocation)
geometry = Element.Geometry(element=select_model_elements)
startPoint = Curve.StartPoint(curve=getLocation)
endPoint = Curve.EndPoint(curve=getLocation)
string = StringInput("Supply Air")
byName = Elements.DuctSystemType.ByName(name=string)
string_2 = StringInput("UniTrunk_CableTrunking_PreGalvanised")
byName_2 = Elements.DuctType.ByName(name=string_2)
levels = Levels("Bottom of Waffle")
byTwoPoints = Elements.Duct.ByTwoPoints(startPoint=startPoint, endPoint=endPoint, ductSystemType=byName, ductType=byName_2, level=levels)
string_3 = StringInput("Width")
code_block = CodeBlock { 5; }
setParameterByName = Element.SetParameterByName(element=byTwoPoints, parameterName=string_3, value=code_block)
string_4 = StringInput("Height")
code_block_2 = CodeBlock { 100; }
setParameterByName_2 = Element.SetParameterByName(element=byTwoPoints, parameterName=string_4, value=code_block_2)
element_getrotation = Custom[Element GetRotation](element=byTwoPoints)  # package Genius Loci; Calculates the rotation angle between the given element and the X axis. Works for point/ line/ sketch based elements and link instances.
intersectsElement = Revit.Element.IntersectsElement(elementSetA=select_model_elements, elementSetB=byTwoPoints)
polyCurvesFromCurvesList = Geometry.Curves.PolyCurvesFromCurvesList(curves=getLocation)
getLocation_2 = Element.GetLocation(element=byTwoPoints)
doesIntersect = Geometry.DoesIntersect(geometry=getLocation, other=getLocation_2)
